# Dynamo graph Nodes.dyn (Dynamo 2.13.1.3887)

code_block = CodeBlock { "Hello world!"; }
createTextBox = Controls.Input.CreateTextBox(text=code_block)
categories = Categories("OST_Levels")
all_elements_of_category = ElementsOfCategory(Category=categories)
code_block_2 = CodeBlock { "Name"; }
createComboBox = Controls.Selection.CreateComboBox(list=all_elements_of_category, displayProp=code_block_2)
categories_2 = Categories("OST_Walls")
all_elements_of_category_2 = ElementsOfCategory(Category=categories_2)
code_block_3 = CodeBlock { "Name"; }
createComboBox_2 = Controls.Selection.CreateComboBox(list=all_elements_of_category_2, displayProp=code_block_3)
list_create = List.Create(item0=createComboBox, item1=createComboBox_2)
code_block_4 = CodeBlock { [1, 1]; [1, 2]; }
code_block_5 = CodeBlock { [1, 1, 0, 1]; [0, 1, 1, 1]; }
createGrid = Controls.Layout.CreateGrid(content=list_create, columnDefinitions=code_block_4.out0, rowDefinitions=code_block_4.out1, elementColumn=code_block_5.out0, elementRow=code_block_5.out1)
code_block_6 = CodeBlock { "OK"; }
createButtonOk = Controls.Buttons.CreateButtonOk(text=code_block_6)
list_create_2 = List.Create(item0=createTextBox, item1=createGrid, item2=createButtonOk)
code_block_7 = CodeBlock { [1]; [1, 8, 1]; }
code_block_8 = CodeBlock { [0]; [0, 1, 2]; }
createGrid_2 = Controls.Layout.CreateGrid(content=list_create_2, columnDefinitions=code_block_7.out0, rowDefinitions=code_block_7.out1, elementColumn=code_block_8.out0, elementRow=code_block_8.out1)
code_block_9 = CodeBlock { 30; }
createBorder = Controls.Layout.CreateBorder(content=createGrid_2, padding=code_block_9)
code_block_10 = CodeBlock { 420; 840; }
code_block_11 = CodeBlock { "DynaDesign"; }
createWindows = Windows.CreateWindows(container=createBorder, height=code_block_10.out0, width=code_block_10.out1, title=code_block_11)
watch = Watch(createWindows)
code_block_12 = CodeBlock { "Select Level"; }
createTextBlock = Controls.UserInformation.CreateTextBlock(text=code_block_12)
code_block_13 = CodeBlock { "Select Family"; }
createTextBlock_2 = Controls.UserInformation.CreateTextBlock(text=code_block_13)
